# Grasshopper definition StdLibTeach.gh (Grasshopper 1.0.8)
# plug-ins: stdlib

joints_25_09_05_16_40_09 = Joints250905164009([0, 0, 0, 0, 0, 0])
joints_25_09_05_16_38_01 = Joints250905163801([0.5290106492, 0.9308422677, -0.4356341813, 1.142492528, 0.7211700469, -1.579522973])
joints_25_09_05_16_38_09 = Joints250905163809([0.5290106492, 0.9308422677, -0.4356341813, 1.142492528, 0.7211700469, -1.579522973])
joints_25_09_05_16_38_11 = Joints250905163811([0.5290106492, 0.9308422677, -0.4356341813, 1.142492528, 0.7211700469, -1.579522973])
entwine = Entwine(
    Branch00=joints_25_09_05_16_40_09,
    Branch01=joints_25_09_05_16_38_01,
    Branch02=joints_25_09_05_16_38_09,
    Branch03=joints_25_09_05_16_38_11,
    FlattenInputs=True)
joint_vector_list = JointVectorList(Joint=entwine, Page=0, Paged=False, Scaling=0)
panel = Panel(joint_vector_list)

robot_communications = RobotCommunications(Location="192.168.125.1:5515", Interval="500", Page=0, Paged=False, Robot=0)  # -> Joints, Inputs, Outputs, Messages, Geometry
model_robot = ModelRobot(Configuration="IRB1205", Page=0, Paged=False, Range=0)  # -> Robot, Ranges
panel_2 = Panel(robot_communications.Messages)
forward_kinematics = ForwardKinematics(Robot=model_robot.Robot, Joints=robot_communications.Joints)  # -> State, Planes
display_robot_model = DisplayRobotModel(Robot=model_robot.Robot, State=forward_kinematics.State, Display=3, High=56, Low=7, Page=0, Paged=False, Tool=448)
